# Grasshopper definition 0801_RoomsWallsDoorsToGraph.gh (Grasshopper 1.0.8)
# plug-ins: RhinoInside.Revit.GH

wall_system_family = WallSystemFamily({"Basic": 0, "Curtain": 1, "Stacked": 2}, selected="Basic")
query_walls = QueryWalls(WallSystemFamily=wall_system_family)
element_geometry = ElementGeometry(Elements=query_walls, DetailLevel=3)
deconstruct_brep = DeconstructBrep(Brep=element_geometry)  # -> Faces, Edges, Vertices
brep = Brep(flatten(deconstruct_brep.Faces))

category = Category(<category referenced from the Revit model>)
category_filter = CategoryFilter(Categories=category, Inverted=False)
query_elements = QueryElements(Filter=category_filter, Limit=100)  # -> Elements, Count
element_geometry_2 = ElementGeometry(Elements=query_elements.Elements, DetailLevel=3)
bounding_box = BoundingBox(Content=element_geometry_2, Plane=PlaneXY(0, 0, 0), UnionBox=True)  # -> Box, Box_2
deconstruct_brep_2 = DeconstructBrep(Brep=bounding_box.Box)  # -> Faces, Edges, Vertices
area = Area(Geometry=deconstruct_brep_2.Faces)  # -> Area, Centroid
sort_list = SortList(Keys=area.Area, ValuesValuesA=deconstruct_brep_2.Faces)  # -> Keys, ValuesValuesA
panel = Panel("""0
1""")
panel_2 = Panel("""4
5""")
panel_3 = Panel("""2
3""")
list_item = ListItem(List=sort_list.ValuesValuesA, Index=panel, Wrap=True)
list_item_2 = ListItem(List=sort_list.ValuesValuesA, Index=panel_2, Wrap=True)
list_item_3 = ListItem(List=sort_list.ValuesValuesA, Index=panel_3, Wrap=True)
discontinuity = Discontinuity(Curve=list_item_2, Level=1)  # -> Points, Parameters
discontinuity_2 = Discontinuity(Curve=list_item, Level=1)  # -> Points, Parameters
discontinuity_3 = Discontinuity(Curve=list_item_3, Level=1)  # -> Points, Parameters
average = Average(Input=discontinuity.Points)
average_2 = Average(Input=discontinuity_2.Points)
average_3 = Average(Input=discontinuity_3.Points)
shift_paths = ShiftPaths(Data=average, Offset=-1)
shift_paths_2 = ShiftPaths(Data=average_2, Offset=-1)
shift_paths_3 = ShiftPaths(Data=average_3, Offset=-1)
list_item_4 = ListItem(List=simplify(shift_paths), Index=graft(panel_2), Wrap=True)  # -> Item, Item1
list_item_5 = ListItem(List=simplify(shift_paths_2), Index=graft(panel), Wrap=True)  # -> Item, Item1
list_item_6 = ListItem(List=simplify(shift_paths_3), Index=graft(panel_3), Wrap=True)  # -> Item, Item1
number_slider = Slider(352, range=0..1000)
number_slider_2 = Slider(300, range=0..1000)
number_slider_3 = Slider(99, range=0..1000)
line = Line(StartPoint=list_item_4.Item, EndPoint=list_item_4.Item1)
line_2 = Line(StartPoint=list_item_5.Item, EndPoint=list_item_5.Item1)
line_3 = Line(StartPoint=list_item_6.Item, EndPoint=list_item_6.Item1)
extend_curve = ExtendCurve(Curve=line, Type=0, Start=number_slider, End=number_slider)
extend_curve_2 = ExtendCurve(Curve=line_2, Type=0, Start=number_slider_2, End=number_slider_2)
extend_curve_3 = ExtendCurve(Curve=line_3, Type=0, Start=number_slider_3, End=number_slider_3)
merge = Merge(Data1=extend_curve, Data2=extend_curve_2, Data3=extend_curve_3)
bounding_box_2 = BoundingBox(Content=merge, Plane=PlaneXY(0, 0, 0), UnionBox=True)  # -> Box, Box_2

shape_in_brep = ShapeInBrep(Brep=bounding_box_2.Box, Shape=brep)
inside = Panel("0")
equality = Equality(FirstNumber=shape_in_brep, SecondNumber=inside)  # -> Equality, Inequality
cull_pattern = CullPattern(List=brep, CullPattern=equality.Equality)
area_2 = Area(Geometry=cull_pattern)  # -> Area, Centroid
deconstruct = Deconstruct(Point=area_2.Centroid)  # -> XComponent, YComponent, ZComponent
sort_list_2 = SortList(Keys=deconstruct.ZComponent, ValuesValuesA=cull_pattern)  # -> Keys, ValuesValuesA
list_item_7 = ListItem(List=sort_list_2.ValuesValuesA, Index=0, Wrap=True)  # -> Item1, Item
top_door_surfaces = Surface(list_item_7.Item1)
unit_z = UnitZ(Factor="2800")

levels_picker = LevelsPicker(<levels picker referenced from the Revit model>)
query_rooms = QueryRooms(Placed=True, Level=levels_picker)
level = Level(levels_picker)
spatial_element_geometry = SpatialElementGeometry(SpatialElement=query_rooms, BoundaryLocation=0)  # -> Geometry, TopFaces, SideFaces, BottomFaces

# ----
# Project rooms and door's top to the elevation of the chosen Revit level,
# so all rooms are in the same height (elevation).
panel_4 = Panel("Elevation")
element_parameter = ElementParameter(Element=level, Parameter=panel_4)  # -> Element, Value
construct_point = ConstructPoint(XCoordinate=0, YCoordinate=0, ZCoordinate=element_parameter.Value)
xy_plane = XYPlane(Origin=construct_point)

project = Project(Geometry=spatial_element_geometry.BottomFaces, Plane=xy_plane)  # -> Geometry, Transform

project_2 = Project(Geometry=top_door_surfaces, Plane=xy_plane)  # -> Geometry, Transform
top_door_surfaces_2 = Surface(project_2.Geometry)
rooms = Brep(project.Geometry)
brep_2 = Brep(flatten([rooms, top_door_surfaces_2]))
clean_tree = CleanTree(RemoveNulls=True, RemoveInvalid=True, RemoveEmpty=False, Tree=brep_2)
extrude = Extrude(Base=clean_tree, Direction=unit_z)
brep_3 = Brep(extrude)
